vi "Main.gvi"   [LabVIEW NXG 3.1.0]
# Use this template to build a simple state machine design pattern. Each state executes code and determines which state to transition to.
panel controls:
  "Exit": bool
  "Do Something <Replace Me>": bool
  "Do Something Else <Replace Me>": bool
types:
  "Data.gtype" = cluster{"Boolean <Replace Me>": bool, "String <Replace Me>": string, "Numeric <Replace Me>": f64}
uses:
  NI::G Core::Error::Display Error.gvi
diagram:
  w1 = "Initialize"  # Initial State
  # This shift register stores the data for the state machine.
  # The state machine will stop if an error occurs. If you want to handle errors in a more sophisticated way, consider adding an "Error" state that will process errors that occur during other states.
  # This shift register stores the current state.
  # This is the Simple State Machine design pattern. Each frame of this case structure executes code for its state and computes what state to transition to next. States are represented as values of an enumeration. These enumerations are instances of a G Type so that states can be quickly added. To edit the G Type, right click on an enumeration and select Open G Type.
  s1 = w1  # shift register
  s2 = "Data.gtype" {all zero or empty}  # shift register
  s3 = no error  # shift register
  while {
    case (s1) {
      frame "Initialize" {
        # #CodeNeeded - Initialize your state data here.
        Property Node(instance in=s2, "Boolean <Replace Me>"=FALSE) -> (instance out=w4)
        # #CodeNeeded - Add code to initialize your user interface here.
        w6 = "Wait for Event"  # Next State
        w7 = FALSE  # Stop Loop?
        w2 = w6
        w3 = w7
        w5 = s3
      }
      frame "Wait for Event" {
        event {
          on "Exit" Value changed {
            w8 = "Exit"  # Next State
            w2 = w8
            w4 = s2
            w5 = s3
          }
          on "Do Something <Replace Me>" Value changed {
            # #CodeNeeded - Modify the state data appropriately for use in the next state.
            Property Node(instance in=s2, "String <Replace Me>"="Running User State 1") -> (instance out=w4)
            w9 = "User State 1"  # Next State
            w2 = w9
            w5 = s3
          }
          on "Do Something Else <Replace Me>" Value changed {
            # #CodeNeeded - Modify the state data appropriately for use in the next state.
            Property Node(instance in=s2, "String <Replace Me>"="Running User State 2") -> (instance out=w4)
            w10 = "User State 2"  # Next State
            w2 = w10
            w5 = s3
          }
          on "Window" Close? {
            Event Filter("Discard?"=TRUE)
            w11 = "Exit"  # Next State
            w2 = w11
            w4 = s2
            w5 = s3
          }
        }
        # Don't ever stop the loop here. Always stop from the "Exit" state.
        w12 = FALSE  # Stop Loop?
        w3 = w12
      }
      frame "User State 1" {
        Property Node(instance in=s2) -> ("String <Replace Me>"=w13)
        # #CodeNeeded - Use the state data to perform whatever action is associated with this state.
        One Button Dialog(message=w13)
        w14 = "Wait for Event"  # Next State
        w2 = w14
        w3 = FALSE
        w4 = s2
        w5 = s3
      }
      frame "User State 2" {
        Property Node(instance in=s2) -> ("String <Replace Me>"=w15)
        # #CodeNeeded - Use the state data to perform whatever action is associated with this state.
        One Button Dialog(message=w15)
        w16 = "Wait for Event"  # Next State
        w2 = w16
        w3 = FALSE
        w4 = s2
        w5 = s3
      }
      frame "Exit" {
        # #CodeNeeded - Add any required cleanup code here.
        # The state value is not used here since this is the last iteration of the state machine loop.
        w17 = "Exit"  # (Value Not Used)
        w18 = TRUE  # Stop Loop?
        w2 = w17
        w3 = w18
        w4 = s2
        w5 = s3
      }
    }
    Logical Or(w5, w3) -> w19
    next s1 = w2
    next s2 = w4
    next s3 = w5
    stop if w19
  }
  call "Display Error.gvi"(error in=s3)
